# Grasshopper definition Test.gh (Grasshopper 1.0.7)

brep = Brep(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)
brep_2 = Brep(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)
pt = ConstructPoint(XCoordinate=Slider(0.6, range=0..1), YCoordinate=Slider(0.5, range=0..1), ZCoordinate=0)
brep_3 = Brep(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)
c_script = CSharpScript(
    Reset=Button(),
    BREP=brep_3,
    uv=pt,
    Acc=Slider(10, range=0..10),
    Reference="D:\研究所\PQMesh\PrincipleCurvature\Bin\PrincipalCurvature.dll")  # -> out, UPts, VPts; inputs Reset: Boolean, BREP: Brep, uv: Point3d, Acc: Double
# ---------- c_script: C# usings ----------
using PrincipalCurvatureCore;
# ---------- c_script: C# ----------
    if(BREP == null || BREP.Faces.Count != 1) return;
    BrepFace face = BREP.Faces[0];
Acc = Acc <= 0 ? 10 : Acc;
    if(Reset || Item.UPts.Count == 0 || PtSave != uv)
    {
      var _uv = new double[]{uv.X, uv.Y};
      PtSave = uv;
      Item = PrincipalCurvature.CurvatureVertices(face, _uv, Acc);
      UPts = Item.UPts;
      VPts = Item.VPts;
    }
    else
    {
      UPts = Item.UPts;
      VPts = Item.VPts;
    }
# ---------- c_script: C# additional code ----------
  PrincipalCurvatureItem Item = new PrincipalCurvatureItem(10);
  Point3d PtSave;
# ---------- end c_script ----------
evalsrf = EvaluateSurface(Surface=reparameterize(brep_3), Point=pt)  # -> Point, Normal, UDirection, VDirection, Frame
pt_2 = Point(c_script.VPts)
pt_3 = Point(c_script.UPts)
number_slider = Slider(5, range=0..10)
series = Series(Start=0, Step=Slider(0.1, range=0..0.1), Count=10)
pt_4 = ConstructPoint(XCoordinate=series, YCoordinate=Slider(0.5, range=0..1), ZCoordinate=0)

# ---- group: Parallel Faster
brep_4 = Brep(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)
c_script_2 = CSharpScript(
    Reset=Button(),
    BREP=brep_4,
    uv=pt_4,
    Acc=number_slider,
    Reference="D:\研究所\PQMesh\PrincipleCurvature\Bin\PrincipalCurvature.dll")  # -> out, UPts, VPts; inputs Reset: Boolean, BREP: Brep, uv: list of Point3d, Acc: Double
# ---------- c_script_2: C# usings ----------
using PrincipalCurvatureCore;
using System.Linq;
# ---------- c_script_2: C# ----------
    if(BREP == null || BREP.Faces.Count != 1 || (!Reset && UPtsTree == null)) return;
    BrepFace face = BREP.Faces[0];
    Acc = Acc <= 0 ? 10 : Acc;
    if(Reset || UPtsTree == null)
    {
      Pts = uv;
      UPtsTree = new DataTree<Point3d>();
      VPtsTree = new DataTree<Point3d>();
      var _uvList = uv.Select(x => new double[2]{x.X, x.Y}).ToList();
      var Items = PrincipalCurvature.ParallelCurvatureVertices(face, _uvList, Acc);
      int Count = 0;
      foreach(PrincipalCurvatureItem Item in Items)
      {
        UPtsTree.AddRange(Item.UPts, new GH_Path(Count));
        VPtsTree.AddRange(Item.VPts, new GH_Path(Count));
        Count++;
      }
    }
    else
    {
      UPts = UPtsTree;
      VPts = VPtsTree;
    }
# ---------- c_script_2: C# additional code ----------
  //PrincipalCurvatureItem Item = new PrincipalCurvatureItem(10);
  DataTree<Point3d> UPtsTree = null;
  DataTree<Point3d> VPtsTree = null;
  List<Point3d> Pts = new List<Point3d>();
# ---------- end c_script_2 ----------
pt_5 = Point(c_script_2.UPts)
pt_6 = Point(c_script_2.VPts)
pline = PolyLine(Vertices=pt_5, Closed=False)
pline_2 = PolyLine(Vertices=pt_6, Closed=False)

# ----
brep_5 = Brep(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)
c_script_3 = CSharpScript(
    Reset=Button(),
    BREP=brep_5,
    uv=pt_4,
    Acc=number_slider,
    Reference="D:\研究所\PQMesh\PrincipleCurvature\Bin\PrincipalCurvature.dll")  # -> out, UPts, VPts; inputs Reset: Boolean, BREP: Brep, uv: list of Point3d, Acc: Double
# ---------- c_script_3: C# ----------
    if(BREP == null || BREP.Faces.Count != 1 || (!Reset && UPtsTree == null)) return;
    BrepFace face = BREP.Faces[0];
Acc = Acc <= 0 ? 10 : Acc;
    if(Reset || UPtsTree == null)
    {
      Pts = uv;
      UPtsTree = new DataTree<Point3d>();
      VPtsTree = new DataTree<Point3d>();
      var _uvList = uv.Select(x => new double[2]{x.X, x.Y}).ToList();
      var Items = PrincipalCurvature.CurvatureVertices(face, _uvList, Acc);
      int Count = 0;
      foreach(PrincipalCurvatureItem Item in Items)
      {
        UPtsTree.AddRange(Item.UPts, new GH_Path(Count));
        VPtsTree.AddRange(Item.VPts, new GH_Path(Count));
        Count++;
      }
    }
    else
    {
      UPts = UPtsTree;
      VPts = VPtsTree;
    }
# ---------- c_script_3: C# additional code ----------
  //PrincipalCurvatureItem Item = new PrincipalCurvatureItem(10);
  DataTree<Point3d> UPtsTree = null;
  DataTree<Point3d> VPtsTree = null;
  List<Point3d> Pts = new List<Point3d>();
# ---------- end c_script_3 ----------
pt_7 = Point(c_script_3.VPts)
pt_8 = Point(c_script_3.UPts)
pline_3 = PolyLine(Vertices=pt_8, Closed=False)
pline_4 = PolyLine(Vertices=pt_7, Closed=False)
